# Grasshopper definition GA Baseline.gh (Grasshopper 1.0.8)

picked_frame = GenePool(
    Decimals=0,
    Maximum=24,
    Minimum=0,
    Value=[18.78426646, 18.12117599, 11.80988486, 15.65082531, 22.33439921, 11.55801183, 0.8770527039, 5.118140836, 9.779887381, 16.722949, 3.278400313, 16.82241747, 21.47874259, 3.807282529, 14.6741058, 14.10355513, 6.869648972, 0.2823190535, 15.25622154, 23.87570396, 12.96357015, 10.29224636, 11.68757601, 3.60788866, 9.884571165])
progress_weight = Slider(1, range=1..3)
distance_weight = Slider(1, range=1..3)
rank_window = Slider(8, range=0..10)
picked_orientation = GenePool(
    Decimals=0,
    Maximum=7,
    Minimum=0,
    Value=[4.016664742, 1.050403396, 1.274955965, 0.1043972856, 0.2485022363, 1.743751043, 1.329144443, 2.514962744, 4.379680148, 3.06328989, 6.51954266, 2.771896369, 3.674948621, 6.421129957, 0.927448193, 5.549779037, 0.2714062187, 0.4299163643, 0.0437133068, 1.87589962, 2.13064655, 1.013575347, 4.908949703, 6.488477089, 0.3177305343])
panel = Panel(picked_orientation)
strict_termination = BooleanToggle(False)
# Next steps before continuing here:
# 
# Push git, check baseline
# 
# Increase termination radius, maybe.
# 
# Add logic for HT connections because I don't want them to make those really big connections with longer elements.
py3 = Python3Script(
    picked_frame=picked_frame,
    picked_orientation=picked_orientation,
    rank_window=rank_window,
    progress_weight=progress_weight,
    distance_weight=distance_weight,
    strict_termination=strict_termination)  # -> out, guide_curve_out, placed_frames_out, bridge_points_out, reuse_skips, no_progress_skips, terminated, true_termination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; inputs picked_frame: list of Int32, picked_orientation: list of Int32, rank_window: Int32, progress_weight: Double, distance_weight: Double, strict_termination: Boolean
# ---------- py3: Python ----------
"""
Grasshopper Python 3 component script.

This is the ONLY file in the baseline GA reconstruction that touches
Rhino/Grasshopper. Everything else (Baseline_GA_Core, Baseline_GA_Utilities)
is plain numpy and imports nothing from Rhino or Grasshopper, matching the
RL framework's own BikeBuilder_Classes / BikeBuilder_Utilities split.

Stock and guide curve are NOT taken from Grasshopper. They are loaded from
the same CSV sources the RL training pipeline uses (IV.frames_v0, IV.arch_v0),
so the GA reconstruction always runs against the same dataset the RL agent is
trained on. The only GH inputs are the GA's own action sequence.

Expected GH component inputs:
    picked_frame        : list[int]  — frame indices, one per timestep
    picked_orientation   : list[int]  — orientation rank picks, one per timestep
    rank_window          : int        — optional, defaults to Baseline_GA_Core's
                                         RANK_WINDOW_DEFAULT if left unconnected
    progress_weight       : float      — optional, defaults to 1.0
    distance_weight       : float      — optional, defaults to 1.0
    strict_termination    : bool       — optional, defaults to False

Outputs:
    placed_frames_out    : Point3d tree — one branch per placed frame, 5 corner points
    bridge_points_out    : Point3d tree — one branch per placed frame, all BikeBridge
                                           points (raw corners + inserted connection
                                           points); EMPTY tree if BikeBridge was not
                                           constructed (i.e. run did not reach
                                           true_termination)
    connections_out       : Point3d tree — one branch per connector triple (long point,
                                           short point, perpendicular point), 3 points
                                           each; one polyline per branch in GH. EMPTY
                                           tree under the same condition as bridge_points_out.
    guide_curve_out        : Point3d list — flat list of the sampled guide curve points
                                           (IV.curve_samples points), same coordinate
                                           frame as everything else (origin-shifted,
                                           unsampled by the GA itself).
    reuse_skips          : int
    no_progress_skips    : int
    no_intersect_skips   : int
    terminated           : bool
    true_termination      : bool
    overshot              : bool
    steps_completed       : int
"""

import sys
sys.path.append(r"C:\Users\rensh\Documents\Master Thesis\REP_STRUC RL\RL Application")
sys.path.append(r"C:\Users\rensh\Documents\Master Thesis\REP_STRUC RL\Main Deployment")

import Rhino.Geometry as rg
import ghpythonlib.treehelpers as th
import importlib
import csv
import numpy as np

import Baseline_GA_Core
import Baseline_GA_Utilities
from environment.envs.BikeBuilder_Classes import BikeFrame
from environment.envs.BikeBuilder_Utilities import resample_curve
from internal_variables import IV

importlib.reload(Baseline_GA_Core)
importlib.reload(Baseline_GA_Utilities)

from Baseline_GA_Core import run_baseline_ga, RANK_WINDOW_DEFAULT
from Baseline_GA_Utilities import placed_frames_to_point_tuples, bridge_points_to_tuples

# =============================================================================
# CSV HELPERS — stdlib csv module, no pandas dependency (GH venv doesn't have it)
# =============================================================================

def _read_csv_rows(path):
    # Returns a list of dict rows, values still as strings — matches what
    # csv.DictReader gives natively. Uses newline='' as csv's docs require,
    # to handle \r\n line endings correctly on all platforms.
    with open(path, newline='') as f:
        reader = csv.DictReader(f)
        return list(reader)

# =============================================================================
# DATA LOADING — same sources as the RL training pipeline (IV.frames_v0, IV.arch_v0)
# =============================================================================

# NOTE: column names below assume the same schema as old_frame_data_v0.csv
# (ST_TOP_X, ST_TOP_Z, HT_TOP_X, HT_TOP_Z, HT_BOTTOM_X, HT_BOTTOM_Z, BB_X, BB_Z,
# CS_SS_X, CS_SS_Z). If IV.frames_v0 (FRAMED_new_set_25.csv) uses different
# column names, only this loading block needs to change.

frame_rows = _read_csv_rows(IV.frames_v0)
frame_stock = []
for row in frame_rows:
    corners = np.array([
        [float(row["ST_TOP_X"]),    float(row["ST_TOP_Z"])],
        [float(row["HT_TOP_X"]),    float(row["HT_TOP_Z"])],
        [float(row["HT_BOTTOM_X"]), float(row["HT_BOTTOM_Z"])],
        [float(row["BB_X"]),        float(row["BB_Z"])],
        [float(row["CS_SS_X"]),     float(row["CS_SS_Z"])],
    ], dtype=np.float32)
    frame_stock.append(BikeFrame(corners))

# NOTE: column names below assume the same schema as simple_arch_v0.csv
# (x_cord, z_cord). If IV.arch_v0 (final_arch_short_true_0_v0.csv) uses
# different column names, only this loading block needs to change.

curve_rows = _read_csv_rows(IV.arch_v0)
raw_guide_curve = np.array([
    [float(row["x_cord"]), float(row["z_cord"])]
    for row in curve_rows
], dtype=np.float32)

# Shift so the curve start sits at IV.origin_position, matching the RL
# training pipeline exactly (BB_arch_environment.__init__ does the same shift).
shift = np.array(IV.origin_position, dtype=np.float32) - raw_guide_curve[0]
raw_guide_curve = (raw_guide_curve + shift).astype(np.float32)

sampled_guide_curve = resample_curve(raw_guide_curve, IV.curve_samples)

# =============================================================================
# OPTIONAL GH INPUT HANDLING
# =============================================================================

_rank_window = rank_window if 'rank_window' in dir() and rank_window else RANK_WINDOW_DEFAULT  # noqa: F821
_progress_weight = progress_weight if 'progress_weight' in dir() and progress_weight else 1.0  # noqa: F821
_distance_weight = distance_weight if 'distance_weight' in dir() and distance_weight else 1.0  # noqa: F821
_strict_termination = bool(strict_termination) if 'strict_termination' in dir() else False  # noqa: F821

# =============================================================================
# RUN
# =============================================================================

result = run_baseline_ga(
    frame_stock         = frame_stock,
    guide_curve          = sampled_guide_curve,
    picked_frame          = list(picked_frame),          # noqa: F821 (GH component input)
    picked_orientation     = list(picked_orientation),      # noqa: F821 (GH component input)
    progress_weight        = _progress_weight,
    distance_weight        = _distance_weight,
    rank_window            = _rank_window,
    strict_termination     = _strict_termination,
)

# =============================================================================
# OUTPUT CONVERSION
# =============================================================================

def _point_tuples_to_tree(nested_tuples):
    # list[list[(x, z)]] -> Point3d DataTree, one branch per outer list entry.
    # Y is set to 0.0 throughout, matching the XZ-plane convention used
    # everywhere else in this project.
    nested_points = [
        [rg.Point3d(x, 0.0, z) for (x, z) in branch]
        for branch in nested_tuples
    ]
    return th.list_to_tree(nested_points)

def _bridge_connections_to_tuples(bike_bridge):
    '''
    Converts bike_bridge.connections into one flat list of point-triples, one
    outer-list entry per connector triple (long_id, short_id, perp_id), each
    resolved to its actual (x, z) coordinate via bike_bridge.points.

    bike_bridge.connections is a list of per-frame-pair connection sets (one
    entry per pair of consecutive frames), each containing 2 triples (the
    straight/cross connector pairing). This flattens that nesting down to a
    single list of triples, since the frame-pair grouping isn't needed for
    rendering — each triple becomes one polyline in Grasshopper, matching how
    BikeBuilder_env_PPO's render_debug draws them individually.

    Point identity (duplicate coordinates vs. the corners/insertions already
    present in bridge_points_out) is intentional, not an oversight —
    Grasshopper has no issue with duplicated point data, and this keeps the
    connections output self-contained without needing to cross-reference
    bridge_points_out by index.

    Kept local to this file rather than in Baseline_GA_Utilities: it's a pure
    output-formatting concern specific to what this GH script chooses to
    expose, not shared logic the core pipeline depends on.
    '''
    triples_out = []
    for connection_set in bike_bridge.connections:
        for triple in connection_set:
            resolved_points = [
                (float(bike_bridge.points[frame_idx][local_idx][0]),
                 float(bike_bridge.points[frame_idx][local_idx][1]))
                for frame_idx, local_idx in triple
            ]
            triples_out.append(resolved_points)
    return triples_out

placed_frames_out = _point_tuples_to_tree(
    placed_frames_to_point_tuples(result.placed_frames)
)

guide_curve_out = [rg.Point3d(float(x), 0.0, float(z)) for (x, z) in sampled_guide_curve]

if result.bike_bridge is not None:
    bridge_points_out = _point_tuples_to_tree(
        bridge_points_to_tuples(result.bike_bridge)
    )
    connections_out = _point_tuples_to_tree(
        _bridge_connections_to_tuples(result.bike_bridge)
    )
else:
    bridge_points_out = _point_tuples_to_tree([])   # empty tree — no BikeBridge built
    connections_out    = _point_tuples_to_tree([])   # empty tree — no BikeBridge built

reuse_skips        = result.tally.reuse_skips
no_progress_skips  = result.tally.no_progress_skips
no_intersect_skips = result.tally.no_intersect_skips
terminated         = result.tally.terminated
true_termination    = result.tally.true_termination
overshot            = result.tally.overshot
steps_completed      = result.tally.steps_completed
# ---------- end py3 ----------
pline = PolyLine(Vertices=py3.placed_frames_out, Closed=True)
intcrv = Interpolate(Vertices=py3.guide_curve_out, Degree=3, Periodic=False, KnotStyle=1)  # -> Curve, Length, Domain
panel_2 = Panel(py3.true_termination)
pline_2 = PolyLine(Vertices=py3.connections_out, Closed=True)
